# Requirement set FunctionalRequirements (R2025b)

## 1 [#1] دمای هر اتاق باید بین 15 تا 20 درجه نگه داشته شود.

## 2 [#2] حداکثر دو بخاری می‌توانند به طور همزمان روشن باشند.

## 3 [#3] هر اتاق حداکثر می‌تواند یک بخاری داشته‌باشد.

## 4 [#4] بخاری‌ها بر اساس شرایط لازم، باید بین اتاق‌ها جابه‌حا شوند.
بخاری اتاق j به اتاق i منتقل می‌شود اگر:
اتاق i بخاری نداشته باشد
اتاق j بخاری داشته باشد
دما xi <= get(i) باشد
اختلاف xj - xi >= diff(i) باشد

## 5 [#5] اگر دمای از آستانه‌ی پایین کمتر شود، بخاری با بیشترین توان شروع به کار می‌کند.

## 6 [#6] اگر دما از آستانه‌ی بالا بیشتر شود، بخاری خاموش می‌شود.

## 7 [#7] طبق رابطه‌ی داده شده، دمای بیرون در کارکرد سیستم تاثیرگذار است.

## 8 [#8] طبق رابطه‌ی داده شده، دمای اتاق‌ها بر هم دیگر اثر می‌گذارند.

## 9 [#9] سیستم باید توسط یک بخش ایمنی، خروجی را کنترل کند.