# Requirement set SafetyRequirements (R2025b)

## 1 [#1] در صورت رسیدن به دماهای آستانه، بخاری باید مدیریت شود تا از مصرف توان بیش از حد جلوگیری شود.

## 2 [#2] اگر سنسور دمایی خراب شود، سیستم باید از آخرین داده‌های معتبر خود استفاده کند.

## 3 [#3] پارامترهای کنترلی (مانند آستانه‌ها) نباید در حین کار تغییر کنند.